# Grasshopper definition FindSmallestCircle.gh (Grasshopper 1.0.8)
# plug-ins: NexoSolve

# ----
# Find Smallest Circle
number_slider = Slider(56, range=0..99)
nvar = NexoVariable(Slider=number_slider, Name="index", Description="The circle index in original list", Unit="unitless")  # -> Value, Variable

rec = Rectangle({Plane=PlaneXY(14.98522459, 14.98522459, 0), Size=Domain2(u=-14.98522459..14.98522459, v=-14.98522459..14.98522459)})
pop2d = Populate2D(Region=rec, Count="100", Seed=1)
random = Random(Range="0.1 to 2", Number="100", Seed=2)
cir = Circle(Plane=pop2d, Radius=random)
item = ListItem(List=cir, Index=nvar.Value, Wrap=invert(True))
srf = Surface(item)
area = Area(Geometry=item)  # -> Area, Centroid
preview = CustomPreview(Geometry=srf, Material="white")

nout = NexoOutput(Value=area.Area, Name="area", Unit="m^2")  # -> Value, Output

screenshot = NexoScreenshot(Name="View", Width=1280, Height=720, SavedViewport="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")
nexosolve = NexoSolveConnector(
    Enabled=True,
    Variables=flatten(nvar.Variable),
    Outputs=flatten(nout.Output),
    Screenshots=flatten(screenshot),
    NexoProjectFolder="C:\Users\Hossein\Documents\NexoSolve\Studies\FindSmallestCircle")  # -> State, Pipe, ModelFingerprint, ResultsFolder
